vi "Main GUI.gvi"   [LabVIEW NXG 1.0.0]
panel controls:
  "Signal": f64 = 5.29850746269
  "Noise": f64 = 5.29850746269
  "Error in measurements": f64
  "Error in previous estimate": f64
  "Previous estimate": f64
  "Stop": bool
panel indicators:
  "Chart": cluster{"Element 1": f64, "Element 2": f64}
  "Kalman gain": f64
uses:
  NI::Analysis::Generation::Uniform White Noise (Scalar DBL).gvi
diagram:
  w1 = 100  # dt
  s1 = $"Previous estimate"  # shift register
  s2 = $"Error in previous estimate"  # shift register
  timed loop {
    Left Timing Source Border Node[AlarmName=L, DefaultTimingSourceName="1 kHz", DefaultTimingSourceType=1](period_in=w1)
    Left Timing Statistics Border Node()
    call "Uniform White Noise (Scalar DBL).gvi"(amplitude=$Noise) -> (uniform white noise=w2)
    Add($Signal, w2) -> w3
    call "Simple Kalman.gvi"(Error in measurements=$"Error in measurements", Measured point=w3, Error in previous estimate=s2, Previous estimate=s1) -> (Kalman gain=w4, New estimate=w5, New error in estimate=w6)
    Build Cluster(w3, w5) -> w7
    $Chart <- w7
    Left Execution System Border Node()
    Left Timing Error Border Node()
    Right Timing Error Border Node()
    $"Kalman gain" <- w4
    next s1 = w5
    next s2 = w6
    stop if $Stop
  }
