vi "Simple Kalman.gvi"   [LabVIEW NXG 1.0.0]
inputs:
  "Error in measurements": f64
  "Measured point": f64
  "Error in previous estimate": f64
  "Previous estimate": f64
outputs:
  "Kalman gain": f64
  "New estimate": f64
  "New error in estimate": f64
diagram:
  Add($"Error in previous estimate", $"Error in measurements") -> w1
  Divide(x=$"Error in previous estimate", y=w1) -> w2
  $"Kalman gain" <- w2
  Subtract(x=1, y=w2) -> w3
  Multiply(w3, $"Error in previous estimate") -> w4
  $"New error in estimate" <- w4
  Subtract(x=$"Measured point", y=$"Previous estimate") -> w5
  Multiply(w5, w2) -> w6
  Add(w6, $"Previous estimate") -> w7
  $"New estimate" <- w7
